# Grasshopper definition CastToTest.gh (Grasshopper 1.0.7)
# plug-ins: CastToDemo

brep = Brep(<brep referenced from the Rhino model>)
casttodemocomponent = CastToDemoComponent(Brep=brep)  # -> BrepCastResult, SurfaceCastResult
panel = Panel(casttodemocomponent.SurfaceCastResult)
panel_2 = Panel(casttodemocomponent.BrepCastResult)
